# Grasshopper definition graphml_to_GH.gh (Grasshopper 1.0.8)
# plug-ins: Pufferfish, ShapeDiverForGrasshopper

sddp = ShapeDiverDocumentPayload({AbsoluteTolerance=0, AngleTolerance=0, DistanceDisplayPrecision=0, GltfVersion="Gltf2", GrasshopperVersion="1.0.0008", InputGroups="{}", OutputGroups="{}", RelativeTolerance=0, RhinoVersion="8.18.25100.11001", UnitSystem=0, VersionCreated="1.25.0.0", VersionSaved="1.25.0.0"})
path = FilePath("C:\Users\CDH\Documents\GitHub\MaCAD25_Thesis\knowledge\streets_graph.graphml")
path_2 = FilePath("C:\Users\CDH\Documents\GitHub\MaCAD25_Thesis\knowledge\urban_graph.graphml")
path_3 = FilePath("C:\Users\CDH\Documents\GitHub\MaCAD25_Thesis\knowledge\streets_graph.graphml")
path_4 = FilePath("C:\Users\CDH\Documents\GitHub\MaCAD25_Thesis\knowledge\urban_graph.graphml")

# ---- group: Loads .graphml
py3 = Python3Script(streets_graph_path=path, urban_graph_path=path_2, reload_trigger=Button())  # -> out, nodes_buildings, edges_buildings, buildings, nodes_streets, streets; inputs streets_graph_path: String, urban_graph_path: String, reload_trigger: Boolean
# ---------- py3: Python ----------
# ----------------------------
# Node A: Load GraphML (Urban + Streets)
# ----------------------------
import Rhino.Geometry as rg
import networkx as nx
import os
from shapely import wkt
from Grasshopper import DataTree
from Grasshopper.Kernel.Data import GH_Path

def load_graphs(urban_path, streets_path):
    if not os.path.exists(urban_path):
        raise ValueError(f"Urban GraphML not found: {urban_path}")
    if not os.path.exists(streets_path):
        raise ValueError(f"Streets GraphML not found: {streets_path}")

    # Load graphs
    G_urban = nx.read_graphml(urban_path)
    G_streets = nx.read_graphml(streets_path)

    urban_nodes_tree = DataTree[object]()
    urban_geometries_tree = DataTree[object]()
    urban_edges = []
    street_nodes = []
    street_edges = []

    # Urban nodes and geometries by type
    for node_id, data in G_urban.nodes(data=True):
        node_type = data.get("type", "unknown")
        x, y = float(data["x"]), float(data["y"])
        pt = rg.Point3d(x, y, 0)

        if node_type == "building":
            branch = GH_Path(0)
        elif node_type == "public_space":
            branch = GH_Path(1)
        else:
            continue  # Skip street nodes or unknown types

        urban_nodes_tree.Add(pt, branch)

        geom_wkt = data.get("geometry_wkt")
        if geom_wkt:
            shape = wkt.loads(geom_wkt)
            if shape.geom_type == "Polygon":
                pts = [rg.Point3d(*p, 0) for p in shape.exterior.coords]
                poly = rg.Polyline(pts)
                urban_geometries_tree.Add(poly, branch)
            else:
                urban_geometries_tree.Add(None, branch)
        else:
            urban_geometries_tree.Add(None, branch)

    # Urban edges (same list for all)
    for u, v in G_urban.edges():
        u_data, v_data = G_urban.nodes[u], G_urban.nodes[v]
        line = rg.Line(
            rg.Point3d(float(u_data["x"]), float(u_data["y"]), 0),
            rg.Point3d(float(v_data["x"]), float(v_data["y"]), 0)
        )
        urban_edges.append(line)

    # Street nodes
    for node_id, data in G_streets.nodes(data=True):
        pt = rg.Point3d(float(data["x"]), float(data["y"]), 0)
        street_nodes.append(pt)

    # Street edges
    for u, v, data in G_streets.edges(data=True):
        geom_wkt = data.get("geometry_wkt")
        if geom_wkt:
            try:
                linestring = wkt.loads(geom_wkt)
                if linestring.geom_type == "LineString":
                    pts = [rg.Point3d(x, y, 0) for x, y in linestring.coords]
                    polyline = rg.Polyline(pts)
                    street_edges.append(polyline)
                else:
                    # Fallback: draw simple straight line
                    u_data = G_streets.nodes[u]
                    v_data = G_streets.nodes[v]
                    line = rg.Line(
                        rg.Point3d(float(u_data["x"]), float(u_data["y"]), 0),
                        rg.Point3d(float(v_data["x"]), float(v_data["y"]), 0)
                    )
                    street_edges.append(line)
            except:
                # Fallback in case of WKT parsing error
                u_data = G_streets.nodes[u]
                v_data = G_streets.nodes[v]
                line = rg.Line(
                    rg.Point3d(float(u_data["x"]), float(u_data["y"]), 0),
                    rg.Point3d(float(v_data["x"]), float(v_data["y"]), 0)
                )
                street_edges.append(line)
        else:
            # No geometry_wkt: fallback straight line
            u_data = G_streets.nodes[u]
            v_data = G_streets.nodes[v]
            line = rg.Line(
                rg.Point3d(float(u_data["x"]), float(u_data["y"]), 0),
                rg.Point3d(float(v_data["x"]), float(v_data["y"]), 0)
            )
            street_edges.append(line)
    return urban_nodes_tree, urban_edges, urban_geometries_tree, street_nodes, street_edges


# Inputs: urban_graph_path, streets_graph_path
# Outputs: a=urban_nodes (split in branches), b=urban_edges, c=urban_geometries (split), d=street_nodes, e=street_edges
nodes_buildings, edges_buildings, buildings, nodes_streets, streets = load_graphs(urban_graph_path, streets_graph_path)
# ---------- end py3 ----------

# ----
py3_2 = Python3Script(streets_graph_path=path_3, urban_graph_path=path_4, reload_trigger=Button())  # -> out, urban_nodes, urban_edges, urban_geometries, street_nodes, street_edges, urban_node_dicts_tree, urban_edge_dicts_tree, street_node_dicts_tree, street_edge_dicts_tree; inputs streets_graph_path: String, urban_graph_path: String, reload_trigger: Boolean
# ---------- py3_2: Python ----------
import Rhino.Geometry as rg
import networkx as nx
import os
from shapely import wkt
from Grasshopper import DataTree
from Grasshopper.Kernel.Data import GH_Path

def list_of_dicts_to_datatree(list_dicts):
    tree = DataTree[object]()
    for i, d in enumerate(list_dicts):
        path = GH_Path(0, i)
        tree.Add(d, path)
    return tree

def load_graphs(urban_path, streets_path):
    if not os.path.exists(urban_path):
        raise ValueError(f"Urban GraphML not found: {urban_path}")
    if not os.path.exists(streets_path):
        raise ValueError(f"Streets GraphML not found: {streets_path}")

    G_urban = nx.read_graphml(urban_path)
    G_streets = nx.read_graphml(streets_path)

    # OUTPUTS
    urban_nodes_tree = DataTree[object]()
    urban_geometries_tree = DataTree[object]()
    urban_edges = []
    street_nodes = []
    street_edges = []

    urban_node_dicts = []
    urban_edge_dicts = []
    street_node_dicts = []
    street_edge_dicts = []

    # --- URBAN GRAPH ---
    for node_id, data in G_urban.nodes(data=True):
        x, y = float(data["x"]), float(data["y"])
        pt = rg.Point3d(x, y, 0)

        node_type = data.get("type", "unknown")
        if node_type == "building":
            branch = GH_Path(0)
        elif node_type == "public_space":
            branch = GH_Path(1)
        else:
            continue

        urban_nodes_tree.Add(pt, branch)

        geom_wkt = data.get("geometry_wkt")
        if geom_wkt:
            shape = wkt.loads(geom_wkt)
            if shape.geom_type == "Polygon":
                pts = [rg.Point3d(*p, 0) for p in shape.exterior.coords]
                poly = rg.Polyline(pts)
                urban_geometries_tree.Add(poly, branch)
                data["geometry"] = poly
            else:
                urban_geometries_tree.Add(None, branch)
                data["geometry"] = None
        else:
            urban_geometries_tree.Add(None, branch)
            data["geometry"] = None

        data["point"] = pt
        data["id"] = node_id
        urban_node_dicts.append(data)

    for u, v, edge_data in G_urban.edges(data=True):
        pt1 = rg.Point3d(float(G_urban.nodes[u]["x"]), float(G_urban.nodes[u]["y"]), 0)
        pt2 = rg.Point3d(float(G_urban.nodes[v]["x"]), float(G_urban.nodes[v]["y"]), 0)
        line = rg.Line(pt1, pt2)
        urban_edges.append(line)

        edge_data["geometry"] = line
        edge_data["source"] = u
        edge_data["target"] = v
        urban_edge_dicts.append(edge_data)

    # --- STREET GRAPH ---
    for node_id, data in G_streets.nodes(data=True):
        x, y = float(data["x"]), float(data["y"])
        pt = rg.Point3d(x, y, 0)
        street_nodes.append(pt)

        data["point"] = pt
        data["id"] = node_id
        street_node_dicts.append(data)

    for u, v, edge_data in G_streets.edges(data=True):
        u_data = G_streets.nodes[u]
        v_data = G_streets.nodes[v]
        pt1 = rg.Point3d(float(u_data["x"]), float(u_data["y"]), 0)
        pt2 = rg.Point3d(float(v_data["x"]), float(v_data["y"]), 0)

        geom_wkt = edge_data.get("geometry_wkt")
        if geom_wkt:
            try:
                shapely_geom = wkt.loads(geom_wkt)
                if shapely_geom.geom_type == "LineString":
                    coords = list(shapely_geom.coords)
                    pts = [rg.Point3d(x, y, 0) for x, y in coords]
                    polyline = rg.Polyline(pts)
                    street_edges.append(polyline)
                    edge_data["geometry"] = polyline
                else:
                    # Fallback simple line
                    line = rg.Line(pt1, pt2)
                    street_edges.append(line)
                    edge_data["geometry"] = line
            except:
                line = rg.Line(pt1, pt2)
                street_edges.append(line)
                edge_data["geometry"] = line
        else:
            line = rg.Line(pt1, pt2)
            street_edges.append(line)
            edge_data["geometry"] = line

        edge_data["source"] = u
        edge_data["target"] = v
        street_edge_dicts.append(edge_data)

    # Convert lists of dicts to DataTrees
    urban_node_dicts_tree = list_of_dicts_to_datatree(urban_node_dicts)
    urban_edge_dicts_tree = list_of_dicts_to_datatree(urban_edge_dicts)
    street_node_dicts_tree = list_of_dicts_to_datatree(street_node_dicts)
    street_edge_dicts_tree = list_of_dicts_to_datatree(street_edge_dicts)

    return (
        urban_nodes_tree, urban_edges, urban_geometries_tree,
        street_nodes, street_edges,
        urban_node_dicts_tree, urban_edge_dicts_tree,
        street_node_dicts_tree, street_edge_dicts_tree
    )

# Inputs: urban_graph_path, streets_graph_path
# Outputs:
# a: urban_nodes (DataTree of Points)
# b: urban_edges (list of Lines)
# c: urban_geometries (DataTree of Polylines or None)
# d: street_nodes (list of Points)
# e: street_edges (list of Lines or Polylines)
# f: urban_node_dicts_tree (DataTree of dicts)
# g: urban_edge_dicts_tree (DataTree of dicts)
# h: street_node_dicts_tree (DataTree of dicts)
# i: street_edge_dicts_tree (DataTree of dicts)

urban_nodes, urban_edges, urban_geometries, street_nodes, street_edges, urban_node_dicts_tree, urban_edge_dicts_tree, street_node_dicts_tree, street_edge_dicts_tree = load_graphs(urban_graph_path, streets_graph_path)
# ---------- end py3_2 ----------
crv = Curve(py3.edges_buildings)
pt = Point(py3_2.urban_nodes)
crv_2 = Curve(py3_2.street_edges)

# ---- group: Extract Geometry
py3_3 = Python3Script(dicts_tree=py3_2.urban_node_dicts_tree)  # -> out, geometries_tree; inputs dicts_tree: tree
# ---------- py3_3: Python ----------
from Grasshopper import DataTree
from Grasshopper.Kernel.Data import GH_Path

def extract_geometries(dicts_tree):
    geometries_tree = DataTree[object]()
    for path in dicts_tree.Paths:
        items = dicts_tree.Branch(path)
        for i, d in enumerate(items):
            geom = d.get('geometry', None)
            geometries_tree.Add(geom, path)
    return geometries_tree

# Input: dicts_tree (DataTree of dicts)
# Output: geometries_tree (DataTree of geometry)

geometries_tree = extract_geometries(dicts_tree)
# ---------- end py3_3 ----------

py3_4 = Python3Script(dicts_tree=py3_2.street_edge_dicts_tree)  # -> out, geometries_tree; inputs dicts_tree: tree; same code as py3_3

# ---- group: Extract key
py3_5 = Python3Script(dicts_tree=py3_2.street_edge_dicts_tree, key_name="name")  # -> out, extracted_tree; inputs dicts_tree: tree, key_name: String
# ---------- py3_5: Python ----------
from Grasshopper import DataTree
from Grasshopper.Kernel.Data import GH_Path

def extract_key_from_datatree(dicts_tree, key_name):
    result_tree = DataTree[object]()
    for path in dicts_tree.Paths:
        branch = dicts_tree.Branch(path)
        extracted_values = []
        for d in branch:
            # d es un dict, extraemos el valor de key_name o None si no existe
            value = d.get(key_name, None)
            extracted_values.append(value)
        result_tree.AddRange(extracted_values, path)
    return result_tree

# Inputs:
# dicts_tree (DataTree de diccionarios)
# key_name (str), por ejemplo 'name'

extracted_tree = extract_key_from_datatree(dicts_tree, key_name)
# ---------- end py3_5 ----------

# ----
pull = PullPoint(Point=graft(pt), Geometry=crv_2, ClosestOnly=True)  # -> ClosestPoint, Distance, Index
crv_3 = Curve(py3_3.geometries_tree)
swatch = ColourSwatch(SwatchColor=RGB(0, 0, 0))
crv_4 = Curve(py3_4.geometries_tree)
long = LongestList(ListA=pt, ListB=simplify(pull.ClosestPoint), PaddingMode=2)  # -> ListA, ListB
midpt = CurveMiddle(Curve=crv_4)
preview = CustomPreview(Geometry=crv_3, Material=swatch)
merge = Merge(Data1=long.ListA, Data2=simplify(pull.ClosestPoint))
cullpt = CullDuplicates(Points=flatten(midpt), Tolerance=0.1, CullMode=1)  # -> Points, Indices, Valence
cps = ClosestPoints(Point=graft(pt), Cloud=merge, Count="2")  # -> ClosestPoint, CPIndex, Distance
item = ListItem(List=flatten(crv_4), Index=cullpt.Indices, Wrap=True)
explode = Explode(Curve=item, Recursive=True)  # -> Segments, Vertices
item_2 = ListItem(List=cps.ClosestPoint, Index="1", Wrap=True)
len = Length(Curve=explode.Segments)
ln = Line(StartPoint=graft(pt), EndPoint=item_2)  # -> flatten(Line)
sort = SortList(Keys=len, ValuesA=explode.Segments)  # -> Keys, reverse(ValuesA)
item_3 = ListItem(List=sort.ValuesA, Index=0, Wrap=True)
join = JoinCurves(Curves=ln, Preserve=False)
crv_5 = Curve(py3.edges_buildings)
crv_6 = Curve(py3.buildings)
explode_2 = Explode(Curve=item_3, Recursive=True)  # -> Segments, Vertices
explode_3 = Explode(Curve=join, Recursive=True)  # -> Segments, Vertices
pdecon = Deconstruct(Point=explode_2.Vertices)  # -> XComponent, YComponent, ZComponent
pt_2 = Point([Point(240793.1514, 5068155.908, 0), Point(240814.8899, 5068152.987, 0), Point(240874.8611, 5068211.049, 0), Point(240817.6542, 5068277.526, 0), Point(240839.1407, 5068253.117, 0), Point(240857.1572, 5068204.577, 0)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])
sort_2 = SortList(Keys=pdecon.XComponent, ValuesA=explode_2.Vertices)  # -> Keys, ValuesA
pull_2 = PullPoint(Point=explode_3.Vertices, Geometry=crv_2, ClosestOnly=True)  # -> ClosestPoint, Distance, Index
item_4 = ListItem(List=sort_2.ValuesA, Index=0, Wrap=True)  # -> Item, Item1
sort_3 = SortList(Keys=pull_2.Distance)  # -> Keys, ValuesA

# ---- group: Overrides .graphml
py3_6 = Python3Script(updated_points=pt_2, node_ids=py3.edges_buildings, original_graphml=path, save_path=path, save_trigger=Button())  # -> out, a, b, c; inputs updated_points: list, node_ids: list, original_graphml: String, save_path: String, save_trigger: Boolean
# ---------- py3_6: Python ----------
# ----------------------------
# Node B: Save GraphML (Writer)
# ----------------------------
import networkx as nx
import os
import rhinoscriptsyntax as rs

def save_graph(updated_points, node_ids, original_graphml, save_path):
    # Check inputs
    if not os.path.exists(original_graphml):
        raise ValueError("Original GraphML file not found: " + original_graphml)
    if len(updated_points) != len(node_ids):
        raise ValueError("Number of updated points does not match number of node IDs.")

    # Load original graph
    G = nx.read_graphml(original_graphml)

    # Update node positions
    for pt_ref, node_id in zip(updated_points, node_ids):
        # Convert GUID reference to Point3d
        pt = rs.coerce3dpoint(pt_ref)
        if pt:  # Ensure conversion succeeded
            if node_id in G.nodes:
                G.nodes[node_id]["x"] = pt.X
                G.nodes[node_id]["y"] = pt.Y
        else:
            raise ValueError("Invalid point reference for node: " + str(node_id))

    # Write updated graph
    nx.write_graphml(G, save_path)
    print("GraphML saved successfully to:", save_path)

# Inputs:
# updated_points: List of Point3d or GUIDs (edited in Rhino)
# node_ids: List of node IDs (from Node A)
# original_graphml: Path to original .graphml
# save_path: Path to save updated .graphml
# save_trigger: Boolean button to trigger save

if save_trigger:
    save_graph(updated_points, node_ids, original_graphml, save_path)
# ---------- end py3_6 ----------

# ----
ln_2 = Line(StartPoint=item_4.Item, EndPoint=item_4.Item1)  # -> flatten(Line)
item_5 = ListItem(List=sort_3.Keys, Index=0, Wrap=True)
panel = Panel(py3.nodes_streets)
equals = Equality(FirstNumber=item_5, SecondNumber="0")  # -> Equality, Inequality
midpt_2 = CurveMiddle(Curve=ln_2)
equalst = EqualityWithinTolerance(FirstNumber=item_5, SecondNumber="0", Tolerance="1")  # -> Equality, Inequality
pl = ConstructPlane(Origin=midpt_2, XAxis=ln_2, YAxis=Vector(0, 1, 0))  # -> graft(Plane)
dispatch = Dispatch(List=join, DispatchPattern=flatten(equalst.Equality))  # -> ListA, ListB
tag = TextTag3D(Location=pl, Text=py3_5.extracted_tree, Size="2", Colour=swatch, Justification=5)
crv_7 = Curve(dispatch.ListB)
explode_4 = Explode(Curve=crv_7, Recursive=True)  # -> Segments, Vertices
pull_3 = PullPoint(Point=explode_4.Vertices, Geometry=crv_2, ClosestOnly=True)  # -> ClosestPoint, Distance, Index
sort_4 = SortList(Keys=pull_3.Distance, ValuesB=explode_4.Vertices, ValuesA=pull_3.ClosestPoint)  # -> Keys, ValuesB, ValuesA
item_6 = ListItem(List=sort_4.ValuesB, Index=0, Wrap=True)
item_7 = ListItem(List=sort_4.ValuesA, Index=0, Wrap=True)
ln_3 = Line(StartPoint=item_6, EndPoint=item_7)
join_2 = JoinCurves(Curves=flatten([crv_7, ln_3]), Preserve=False)
crv_8 = Curve(dispatch.ListA)
merge_2 = Merge(Data1=crv_8, Data2=join_2)
